# Dynamo graph DPP_HempBlock_Element.dyn (Dynamo 3.4.1.7055)

family_types = FamilyTypes("DPP_HempBlock_Material:DPP_HempBlock_Material")
code_block = CodeBlock { 0; 800; 500; }
range = Range(start=code_block.out0, end=code_block.out1, step=code_block.out2)
code_block_2 = CodeBlock { 0; }
code_block_3 = CodeBlock { 0; 800; 420; }
range_2 = Range(start=code_block_3.out0, end=code_block_3.out1, step=code_block_3.out2)
byCoordinates = Point.ByCoordinates(x=range, y=code_block_2, z=range_2, lacing=CrossProduct)
code_block_4 = CodeBlock { 0+[500/3]; 1000; 500; }
range_3 = Range(start=code_block_4.out0, end=code_block_4.out1, step=code_block_4.out2)
code_block_5 = CodeBlock { 0; }
code_block_6 = CodeBlock { 210; 630; 420; }
range_4 = Range(start=code_block_6.out0, end=code_block_6.out1, step=code_block_6.out2)
byCoordinates_2 = Point.ByCoordinates(x=range_3, y=code_block_5, z=range_4, lacing=CrossProduct)
list_create = List.Create(item0=byCoordinates, item1=byCoordinates_2)
flatten = List.Flatten(list=list_create)
byPoint = FamilyInstance.ByPoint(familyType=family_types, point=flatten)
code_block_7 = CodeBlock {  }
