# Dynamo graph DPP_HempBlock_Material.dyn (Dynamo 3.4.1.7055)

# group: Dimensions
# in mm
width_in_mm = DoubleSlider(500, range=0..700 step 0.1)
length_in_mm = DoubleSlider(80, range=0..700 step 0.1)
height_in_mm = DoubleSlider(200, range=0..700 step 0.1)

# group: Base Geometry
origin = Point.Origin()
byOrigin = CoordinateSystem.ByOrigin(origin=origin)
code_block = CodeBlock(Width_mm=width_in_mm, Length_mm=length_in_mm, Height_mm=height_in_mm)
# ---------- code_block.designscript (5 lines) ----------
// conversion factor
mmToFt = 1 / 304.8;
W = Width_mm * mmToFt;
L = Length_mm * mmToFt;
H = Height_mm * mmToFt;
# ----------------------------------------
base = Cuboid.ByLengths(origin=byOrigin, width=code_block.W, length=code_block.L, height=code_block.H)

# group: Rebates
code_block_2 = CodeBlock(L=code_block.L)
# ---------- code_block_2.designscript (10 lines) ----------
// Rebate parameters (in mm)
RebateDepth_mm = 10;
     // how deep the rebate cuts in;
RebateLengthFactor = 1/3;
 // one-third of the total length;

// Convert mm→ft and compute actual sizes
mmToFt = 1/304.8;
RebateDepth = RebateDepth_mm * mmToFt;
RebateLength = L * RebateLengthFactor;
# ----------------------------------------
byLengths = Cuboid.ByLengths(origin=byOrigin, width=code_block_2.RebateDepth, length=code_block_2.RebateLength, height=code_block.H)
code_block_3 = CodeBlock(W=code_block.W, RebateDepth=code_block_2.RebateDepth)
# ---------- code_block_3.designscript (7 lines) ----------
// Rebate translation (with new base position)
xShift = (W/2) + (RebateDepth/2);
 // pushes rebate to far side in X;
yShift = 0;
 // centered along Y;
zShift = 0;
 // same bottom level;
# ----------------------------------------
translate = Geometry.Translate(geometry=byLengths, xTranslation=code_block_3.xShift, yTranslation=code_block_3.yShift, zTranslation=code_block_3.zShift)
YZ = Plane.YZ()
mirror = Geometry.Mirror(geometry=translate, mirrorPlane=YZ)
code_block_4 = CodeBlock(RebateDepth=code_block_2.RebateDepth) { xShift = RebateDepth; yShift = 0; zShift = 0; }
translate_2 = Geometry.Translate(geometry=mirror, xTranslation=code_block_4.xShift, yTranslation=code_block_4.yShift, zTranslation=code_block_4.zShift)

# group: Final Geometry
union = Solid.Union(solid=translate, solid_2=base)
difference = Solid.Difference(solid=union, other=translate_2)

# group: Family creation
family_name = CodeBlock { "DPP_HempBlock"; }
categories = Categories("OST_GenericModel")
file_path = Filename("..\..\..\..\..\..\..\ProgramData\Autodesk\RVT 2026\Family Templates\English\Metric Generic Model.rft")
material_name = StringInput("Hemp-Lime")
byName = Material.ByName(name=material_name)
byGeometry = FamilyType.ByGeometry(solidGeometry=difference, name=family_name, category=categories, templatePath=file_path, material=byName)
