# Dynamo graph Imput parameters.dyn (Dynamo 3.4.1.7055)
# packages: Crumple 2026.8.1

# group: Search family files in folder
directory_path = Directory("C:\Users\Catalina\OneDrive - Pontificia Universidad Javeriana\Desktop\THESIS\Methodology\Base Files\Dynamo")
code_block = CodeBlock { ".rfa"; }
directory_contents = Custom[© Directory.Contents](directoryPath=directory_path, searchString=code_block)  # package Crumple; Be aware there is an OOTB node that can do this, but I wanted to add this to the package so others can see how to use a Python method as a starter block in other scripts.
familydoc_open = Custom[© FamilyDoc.Open](filePaths=directory_contents)  # package Crumple; Given a file path to a family, attempts to open that document in the background in Revit if possible. Should not be used for regular models/templates.

# group: Excel file
file_path = Filename("..\Base for dynamo workflow (add parameters).xlsx")

# group: Retrive info from excel
file_from_path = FileObject(path=file_path)
code_block_2 = CodeBlock { "Standard"; true; false; }
importExcel = Data.ImportExcel(file=file_from_path, sheetName=code_block_2.out0, readAsStrings=code_block_2.out1, showExcel=code_block_2.out2)
restOfItems = List.RestOfItems(list=importExcel)
transpose = List.Transpose(lists=restOfItems)
code_block_3 = CodeBlock(data=transpose) { name=data[0]; bpig=data[1]; inst=data[2]; }

# group: Retrive revit API info
sharedparameters_flat = Custom[© SharedParameters.Flat]()  # package Crumple; Returns all shared parameters as definition and name, as well as their corresponding group and name.
indexOf = List.IndexOf(list=sharedparameters_flat.paramNames, element=code_block_3.name)
code_block_4 = CodeBlock(pdef=sharedparameters_flat.paramDefs, i=indexOf) { pdef[i]; }
parameter_bipgbyname = Custom[© Parameter.BIPGbyName](name=code_block_3.bpig)  # package Crumple; Given a string or list of strings, return the corresponding BuiltIn Parameter Group.

# group: Add shared params
familydoc_addsharedparameters = Custom[© FamilyDoc.AddSharedParameters](familyDocs=familydoc_open.familyDocs, exDefLists=code_block_4, parGroupLists=parameter_bipgbyname, isInstanceLists=code_block_3.inst)  # package Crumple; Given a family document or list of them, attempts to create shared parameters in them. Input structures should be in the form of one sub-list per family document, in a list (but the node will try to create this data structure if not, as well as repeat the last list if they are shorter than the family document list).

# group: Save and close family file
flow_waitfor = Custom[© Flow.WaitFor](data=familydoc_open.familyDocs, waitFor=familydoc_addsharedparameters.outcomeLists)  # package Crumple; Tells the first input to wait for the second input to arrive, then passes on the first input. Really useful for scripts which have branching paths that rely on their outputs to carry each other forward. Quite a few custom packages have a 'passthrough' or 'waitfor' node. I use these all the time, so find it useful to have them contained in this package also.
code_block_5 = CodeBlock { true; }
familydoc_close = Custom[© FamilyDoc.Close](familyDocs=flow_waitfor, saveOption=code_block_5)  # package Crumple; Given documents in the unwrapped state, attempts to close then with the option to save them (applies to all documents, one input expected, not a list).
