# Dynamo graph Set parameters by excel.dyn (Dynamo 3.4.1.7055)
# packages: Crumple 2022.5.27

# group: Open family documents
directory_path = Directory("C:\Users\Catalina\OneDrive - Pontificia Universidad Javeriana\Desktop\THESIS\Methodology\Base Files\Dynamo")
code_block = CodeBlock { ".rfa"; false; }
windows_directorycontents = Custom[© Windows.DirectoryContents](directoryPath=directory_path, searchString=code_block.out0, deepSearch=code_block.out1)  # package Crumple; Be aware there is an OOTB node that can do this, but I wanted to add this to the package so others can see how to use a Python method as a starter block in other scripts.
familydoc_open = Custom[© FamilyDoc.Open](filePaths=windows_directorycontents)  # package Crumple; Given a file path to a family, attempts to open that document in the background in Revit if possible. Should not be used for regular models/templates.

# group: Get Excel data
file_path = Filename("..\Documents\Crumple_SetFormulae.xlsx")
file_from_path = FileObject(path=file_path)
code_block_2 = CodeBlock { "Data"; true; }
importExcel = Data.ImportExcel(file=file_from_path, sheetName=code_block_2.out0, readAsStrings=code_block_2.out1)
deconstruct = List.Deconstruct(list=importExcel)
code_block_3 = CodeBlock { 1; }
dropItems = List.DropItems(list=deconstruct.first, amount=code_block_3)

# group: Set parameters by Excel data matching
python_script_set_parameter = Python(IN[0]=familydoc_open.familyDocs, IN[1]=dropItems, IN[2]=deconstruct.rest)  # "Python Script (Set parameter value by Excel)"; CPython3
# ---------- python_script_set_parameter.python (113 lines) ----------
# Made by Gavin Crump
# Modified for CPython3 compatibility
# Free for use
# BIM Guru, www.bimguru.com.au

# Boilerplate text
import clr

clr.AddReference("RevitServices")
import RevitServices
from RevitServices.Persistence import DocumentManager
from RevitServices.Transactions import TransactionManager 

clr.AddReference("RevitAPI")
import Autodesk 
from Autodesk.Revit.DB import *

# Import for CPython3 unwrapping
import sys
pyt_path = r'C:\Program Files (x86)\IronPython 2.7\Lib'
sys.path.append(pyt_path)

# Preparing input from dynamo to revit
famDocs_input = IN[0]

# CRITICAL: Unwrap Dynamo objects for CPython3
if isinstance(famDocs_input, list):
    famDocs = [UnwrapElement(f) if hasattr(__builtins__, 'UnwrapElement') else f for f in famDocs_input]
else:
    famDocs = [UnwrapElement(famDocs_input) if hasattr(__builtins__, 'UnwrapElement') else famDocs_input]

# Ensure we have valid documents
famDocs = [f for f in famDocs if f is not None and isinstance(f, Document)]

# Get all the data we need to check vs excel
famTypesList, famTypeNamesList, famNames, famParamsList, famParamNamesList = [], [], [], [], []

for f in famDocs:
    try:
        # Get family name and manager
        famMan = f.FamilyManager
        famNames.append(f.Title)
        # Get type data
        famTypes = list(famMan.Types)
        typeNames = [ft.Name for ft in famTypes]
        famTypesList.append(famTypes)
        famTypeNamesList.append(typeNames)
        # Get parameters
        params = list(famMan.GetParameters())
        paramNames = [p.Definition.Name for p in params]
        famParamsList.append(params)
        famParamNamesList.append(paramNames)
    except Exception as e:
        # Skip invalid documents
        continue

# Function to set family parameter value for a type
def setFamilyParam(famDoc, p, t, v):
    try:
        famMan = famDoc.FamilyManager
        famMan.CurrentType = t
        famMan.Set(p, v)
        return True
    except Exception as ex:
        return str(ex)

# Work through excel data
paramNames = IN[1]
excelData = IN[2]

outcomesList = []

for row in excelData:
    # Results for this row
    outcomes = []
    try:
        # Get the family
        famInd = famNames.index(row[0])
        famDoc = famDocs[famInd]
        # Get the type
        typeInd = famTypeNamesList[famInd].index(row[1])
        famType = famTypesList[famInd][typeInd]
        # Limit to the parameter columns
        values = row[2:]
        
        # Start a transaction in the family document
        t = Transaction(famDoc, row[0] + " - " + row[1])
        t.Start()
        
        # For each param/value pair for this type...
        for p, v in zip(paramNames, values):
            try:
                # Get the parameter
                parInd = famParamNamesList[famInd].index(p)
                famPar = famParamsList[famInd][parInd]
                # Set the parameter
                setParam = setFamilyParam(famDoc, famPar, famType, v)
                outcomes.append(setParam)
            except ValueError:
                outcomes.append(f"Parameter '{p}' not found")
            except Exception as ex:
                outcomes.append(f"Error: {str(ex)}")
        
        # Commit the transaction
        t.Commit()
    except Exception as ex:
        outcomes.append(f"Row error: {str(ex)}")
    
    # Append outcomes to list
    outcomesList.append(outcomes)

# Preparing output to Dynamo
OUT = outcomesList
# ----------------------------------------

# group: Close family documents once changes are made
flow_waitfor = Custom[© Flow.WaitFor](data=familydoc_open.familyDocs, waitFor=python_script_set_parameter)  # package Crumple; Tells the first input to wait for the second input to arrive, then passes on the first input. Really useful for scripts which have branching paths that rely on their outputs to carry each other forward. Quite a few custom packages have a 'passthrough' or 'waitfor' node. I use these all the time, so find it useful to have them contained in this package also.
code_block_4 = CodeBlock { true; }
familydoc_close = Custom[© FamilyDoc.Close](familyDocs=flow_waitfor, saveOption=code_block_4)  # package Crumple; Given documents in the unwrapped state, attempts to close then with the option to save them (applies to all documents, one input expected, not a list).
